vi "Close.gvi"   [LabVIEW NXG 3.0.0]
# Use this VI to close references needed by the dam.
# This VI executes regardless of any incoming error.
inputs:
  "Dam in": "Dam.gtype", required
  "Error in": error
outputs:
  "Error out": error
uses:
  Report.gtype::Close.gvi
  Turbine.gtype::Close.gvi
  Floodgate.gtype::Close.gvi
  Lake.gtype::Close.gvi
  NI::G Core::Error::Multiplex Errors.gvi
diagram:
  Property Node(instance in=$"Dam in") -> ("Lake"=w1, "Large floodgates"=w2, "Small floodgates"=w3, "Turbines"=w4, "Report"=w5, error out=w6)
  call "Close.gvi"(Report in=w5, Error in=w6) -> (Error out=w7)
  for {
    w8 = each element of w4
    call "Close.gvi"(Turbine in=w8, Error in=w6) -> (Error out=w10)
    append w10 to w9
  }
  for {
    w11 = each element of w3
    call "Close.gvi"(Floodgate in=w11, Error in=w6) -> (Error out=w13)
    append w13 to w12
  }
  call "Close.gvi"(Lake in=w1, Error in=w6) -> (Error out=w14)
  for {
    w15 = each element of w2
    call "Close.gvi"(Floodgate in=w15, Error in=w6) -> (Error out=w17)
    append w17 to w16
  }
  call "Multiplex Errors.gvi"(error in 1=$"Error in", error in 2=w14, error array in=w16) -> (error out=w18)
  call "Multiplex Errors.gvi"(error in 1=w18, error array in=w12) -> (error out=w19)
  call "Multiplex Errors.gvi"(error in 1=w19, error in 2=w7, error array in=w9) -> (error out=w20)
  $"Error out" <- w20
