vi "Get Dams Data.gvi"   [LabVIEW NXG 3.0.0]
# Use this VI to retrieve the dam’s internal data
inputs:
  "Dam in": "Dam.gtype", required
  "Error in": error
outputs:
  "Dam's data": "Report Data.gtype"
  "Dam out": "Dam.gtype"
  "Error out": error
types:
  "Lake properties.gtype" = cluster{"Lake Fill (Acre-feet)": f64, "Lake Intake Rate (cfs)": f64, "Lake Discharge Rate (cfs)": f64}
  "Large Floodgates properties.gtype" = cluster{"# of Large Floodgates": i32, "Large Flodgates Size (cfs)": f64, "Large Floodgates Status": bool[]}
  "Small Floodgates properties.gtype" = cluster{"# of Small Floodgates": i32, "Small Floodgates Size (cfs)": f64, "Small Floodgates Status": bool[]}
  "Turbines properties.gtype" = cluster{"# of Turbines": i32, "Power at Max Flow (MW)": f64, "Turbine Gates Status": bool[], "Turbines State (%)": f64[], "Total Power Being Generated (MW)": f64, "Max Flow (cfs)": f64}
  "Report Data.gtype" = cluster{"Lake properties": "Lake properties.gtype", "Large Floodgates properties": "Large Floodgates properties.gtype", "Small Floodgates properties": "Small Floodgates properties.gtype", "Turbines properties": "Turbines properties.gtype"}
uses:
  Turbine.gtype::Read Generated Power.gvi
  Floodgate.gtype::Get Discharge.gvi
  Lake.gtype::Read Lake Level.gvi
diagram:
  w1 = "Report Data.gtype" {"Lake properties"={"Lake Fill (Acre-feet)"=0, "Lake Intake Rate (cfs)"=0, "Lake Discharge Rate (cfs)"=0}, "Large Floodgates properties"={"# of Large Floodgates"=4, "Large Flodgates Size (cfs)"=0, "Large Floodgates Status"=[]}, "Small Floodgates properties"={"# of Small Floodgates"=5, "Small Floodgates Size (cfs)"=0, "Small Floodgates Status"=[]}, "Turbines properties"={"# of Turbines"=2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}}  # Report Data
  case ($"Error in") {
    frame No Error {
      Property Node(instance in=$"Dam in", error in=$"Error in") -> ("Lake"=w5, "Large floodgates"=w6, "Small floodgates"=w7, "Turbines"=w8, error out=w9, instance out=w10)
      s1 = w9  # shift register
      for (N -> w11) {
        w12 = each element of w8
        call "Read Generated Power.gvi"(Turbine in=w12, Error in=s1) -> (Power at Max Flow (MW)=w17, Open Percentage (%)=w18, Turbine out=w19, Power Generated (MW)=w20, Gate State (FALSE = Closed)=w21, Error out=w22, Max Flow (cfs)=w23)
        append w19 to w13
        append w21 to w14
        append w18 to w15
        append w20 to w16
        next s1 = w22
      }
      s2 = w9  # shift register
      for (N -> w24) {
        w25 = each element of w6
        call "Get Discharge.gvi"(Floodgate in=w25, Error in=s2) -> (Size (cfs)=w28, Floodgate out=w29, Open?=w30, Error out=w31)
        append w29 to w26
        append w30 to w27
        next s2 = w31
      }
      s3 = w9  # shift register
      for (N -> w32) {
        w33 = each element of w7
        call "Get Discharge.gvi"(Floodgate in=w33, Error in=s3) -> (Size (cfs)=w36, Floodgate out=w37, Open?=w38, Error out=w39)
        append w37 to w34
        append w38 to w35
        next s3 = w39
      }
      call "Read Lake Level.gvi"(Lake in=w5, Error in=w9) -> (Intake Rate (cfs)=w40, Discharge Rate (cfs)=w41, Lake out=w42, Fill (Acre-feet)=w43, Error out=w44)
      Merge Errors(w44, s2, s3, s1) -> (error out=w45)
      Property Node(instance in=w10, "Lake"=w42, "Large floodgates"=w26, "Small floodgates"=w34, "Turbines"=w13, error in=w45) -> (error out=w2, instance out=w3)
      Add Array Elements(numeric array=w16) -> (sum=w46)
      in-place (after w1) {
        Unbundle Bundle Read Poser() -> ("Lake properties"=w47, "Large Floodgates properties"=w48, "Small Floodgates properties"=w49, "Turbines properties"=w50)
        Property Node(instance in=w50, "# of Turbines"=w11, "Power at Max Flow (MW)"=w17, "Turbine Gates Status"=w14, "Turbines State (%)"=w15, "Total Power Being Generated (MW)"=w46, "Max Flow (cfs)"=w23) -> (instance out=w51)
        Property Node(instance in=w48, "# of Large Floodgates"=w24, "Large Flodgates Size (cfs)"=w28, "Large Floodgates Status"=w27) -> (instance out=w52)
        Property Node(instance in=w49, "# of Small Floodgates"=w32, "Small Floodgates Size (cfs)"=w36, "Small Floodgates Status"=w35) -> (instance out=w53)
        Property Node(instance in=w47, "Lake Fill (Acre-feet)"=w43, "Lake Intake Rate (cfs)"=w40, "Lake Discharge Rate (cfs)"=w41) -> (instance out=w54)
        Unbundle Bundle Write Poser("Lake properties"=w54, "Large Floodgates properties"=w52, "Small Floodgates properties"=w53, "Turbines properties"=w51)
        w4 = _
      }
    }
    frame Error {
      w2 = $"Error in"
      w3 = $"Dam in"
      w4 = default
    }
  }
  $"Dam out" <- w3
  $"Error out" <- w2
  $"Dam's data" <- w4
