vi "Init.gvi"   [LabVIEW NXG 3.0.0]
# This VI creates a dam based on it’s last logged state in the input log path.
inputs:
  "Log Path In": path
  "Reset?": bool
  "Error in": error
outputs:
  "Log Path Out": path
  "Dam out": "Dam.gtype"
  "Error out": error
  "Dam's Max Power Output": f64
types:
  "Lake properties.gtype" = cluster{"Lake Fill (Acre-feet)": f64, "Lake Intake Rate (cfs)": f64, "Lake Discharge Rate (cfs)": f64}
  "Large Floodgates properties.gtype" = cluster{"# of Large Floodgates": i32, "Large Flodgates Size (cfs)": f64, "Large Floodgates Status": bool[]}
  "Small Floodgates properties.gtype" = cluster{"# of Small Floodgates": i32, "Small Floodgates Size (cfs)": f64, "Small Floodgates Status": bool[]}
  "Turbines properties.gtype" = cluster{"# of Turbines": i32, "Power at Max Flow (MW)": f64, "Turbine Gates Status": bool[], "Turbines State (%)": f64[], "Total Power Being Generated (MW)": f64, "Max Flow (cfs)": f64}
  "Report Data.gtype" = cluster{"Lake properties": "Lake properties.gtype", "Large Floodgates properties": "Large Floodgates properties.gtype", "Small Floodgates properties": "Small Floodgates properties.gtype", "Turbines properties": "Turbines properties.gtype"}
uses:
  Turbine.gtype::Init.gvi
  Turbine.gtype::Read Generated Power.gvi
  Floodgate.gtype::Init.gvi
  Floodgate.gtype::Get Discharge.gvi
  Lake.gtype::Init.gvi
  Lake.gtype::Add Discharge.gvi
  Report.gtype::Open or Create.gvi
diagram:
  w1 = "Report Data.gtype" {"Lake properties"={"Lake Fill (Acre-feet)"=1100000, "Lake Intake Rate (cfs)"=1000, "Lake Discharge Rate (cfs)"=0}, "Large Floodgates properties"={"# of Large Floodgates"=4, "Large Flodgates Size (cfs)"=15300, "Large Floodgates Status"=[]}, "Small Floodgates properties"={"# of Small Floodgates"=5, "Small Floodgates Size (cfs)"=8600, "Small Floodgates Status"=[]}, "Turbines properties"={"# of Turbines"=2, "Power at Max Flow (MW)"=8.5, "Turbine Gates Status"=[], "Turbines State (%)"=[], "Total Power Being Generated (MW)"=0, "Max Flow (cfs)"=1750}}  # Default Data
  Property Node(instance in=w1) -> ("Large Floodgates properties"=w2, "Small Floodgates properties"=w3, "Turbines properties"=w4, instance out=w5)
  Property Node(instance in=w2) -> ("# of Large Floodgates"=w6, instance out=w7)
  Initialize Array(element=FALSE, size=w6) -> w8
  Property Node(instance in=w7, "Large Floodgates Status"=w8) -> (instance out=w9)
  Property Node(instance in=w3) -> ("# of Small Floodgates"=w10, instance out=w11)
  Initialize Array(element=FALSE, size=w10) -> w12
  Property Node(instance in=w11, "Small Floodgates Status"=w12) -> (instance out=w13)
  Property Node(instance in=w4) -> ("# of Turbines"=w14, instance out=w15)
  Initialize Array(element=TRUE, size=w14) -> w16
  Initialize Array(element=100, size=w14) -> w17
  Property Node(instance in=w15, "Turbine Gates Status"=w16, "Turbines State (%)"=w17) -> (instance out=w18)
  Property Node(instance in=w5, "Large Floodgates properties"=w9, "Small Floodgates properties"=w13, "Turbines properties"=w18) -> (instance out=w19)
  # Lake discharge is calculated when the application starts,
  # so we make sure we have the correct amount
  case ($"Error in") {
    frame No Error {
      Property Node(instance in=w19) -> ("Lake properties"=w24, "Large Floodgates properties"=w25, "Small Floodgates properties"=w26, "Turbines properties"=w27)
      Property Node(instance in=w27) -> ("# of Turbines"=w28, "Power at Max Flow (MW)"=w29, "Turbine Gates Status"=w30, "Turbines State (%)"=w31, "Max Flow (cfs)"=w32)
      s1 = $"Error in"  # shift register
      for (N = w28) (iteration -> i1) {
        Array Index(array=w30) -> (out0[i1]=w36)
        Array Index(array=w31) -> (out0[i1]=w37)
        call "Init.gvi"(Power at Max Flow (MW)=w29, Gate State (FALSE = Closed)=w36, Open Percentage (%)=w37, Error in=s1, Max Flow (cfs)=w32) -> (Turbine out=w38, Error out=w39)
        call "Read Generated Power.gvi"(Turbine in=w38, Error in=w39) -> (Turbine out=w40, Error out=w41, Flow (cfs)=w42)
        append w40 to w33
        append w29 to w34
        append w42 to w35
        next s1 = w41
      }
      Property Node(instance in=w25) -> ("# of Large Floodgates"=w43, "Large Flodgates Size (cfs)"=w44, "Large Floodgates Status"=w45)
      s2 = $"Error in"  # shift register
      for (N = w43) (iteration -> i2) {
        Array Index(array=w45) -> (out0[i2]=w48)
        call "Init.gvi"(Size (cfs)=w44, State (FALSE = Closed)=w48, Error in=s2) -> (Floodgate out=w49, Error out=w50)
        call "Get Discharge.gvi"(Floodgate in=w49, Error in=w50) -> (Floodgate out=w51, Discharge (cfs)=w52, Error out=w53)
        append w51 to w46
        append w52 to w47
        next s2 = w53
      }
      Property Node(instance in=w26) -> ("# of Small Floodgates"=w54, "Small Floodgates Size (cfs)"=w55, "Small Floodgates Status"=w56)
      s3 = $"Error in"  # shift register
      for (N = w54) (iteration -> i3) {
        Array Index(array=w56) -> (out0[i3]=w59)
        call "Init.gvi"(Size (cfs)=w55, State (FALSE = Closed)=w59, Error in=s3) -> (Floodgate out=w60, Error out=w61)
        call "Get Discharge.gvi"(Floodgate in=w60, Error in=w61) -> (Floodgate out=w62, Discharge (cfs)=w63, Error out=w64)
        append w62 to w57
        append w63 to w58
        next s3 = w64
      }
      Property Node(instance in=w24) -> ("Lake Fill (Acre-feet)"=w65, "Lake Intake Rate (cfs)"=w66)
      call "Init.gvi"(Fill (Acre-feet)=w65, Intake Rate (cfs)=w66, Discharge Rate (cfs)=0, Error in=$"Error in") -> (Lake out=w67, Error out=w68)
      Add Array Elements(numeric array=w35) -> (sum=w69)
      call "Add Discharge.gvi"(Lake in=w67, Add Discharge Rate (cfs)=w69, Error in=w68) -> (Lake out=w70, Error out=w71)
      call "Open or Create.gvi"(Log Path In=$"Log Path In", Error in=$"Error in") -> (Report out=w72, Log Path Out=w22, Error out=w73)
      Merge Errors(w71, s2, s3, s1, w73) -> (error out=w74)
      Property Node(instance in="Dam.gtype" constant, "Lake"=w70, "Turbines"=w33, "Large floodgates"=w46, "Small floodgates"=w57, "Report"=w72, error in=w74) -> (error out=w20, instance out=w21)
      Add Array Elements(numeric array=w47) -> (sum=w75)
      Add Array Elements(numeric array=w58) -> (sum=w76)
      Add Array Elements(numeric array=w34) -> (sum=w77)
      Add(w75, w76, w77) -> w23
    }
    frame Error {
      w20 = $"Error in"
      w21 = "Dam.gtype" constant
      w22 = default
      w23 = default
    }
  }
  $"Dam's Max Power Output" <- w23
  $"Dam out" <- w21
  $"Error out" <- w20
  $"Log Path Out" <- w22
