vi "Open Config File.gvi"   [LabVIEW NXG 3.0.0]
# This VI opens a reference to the configuration file that holds the dam’s data
inputs:
  "Status backup": path
  "Dam in": "Dam.gtype", required
  "Error in": error
outputs:
  "Dam out": "Dam.gtype"
  "Error out": error
uses:
  NI::G Core::File IO (General)::Get System Directory.gvi
diagram:
  case ($"Error in") {
    frame No Error {
      Property Node(instance in=$"Dam in", error in=$"Error in") -> ("Backup"=w3, error out=w4, instance out=w5)
      Is Empty String Or Path(string/path=$"Status backup") -> w6
      case (w6) {
        frame False, Default {
          w7 = $"Status backup"
        }
        frame True {
          call "Get System Directory.gvi"(type="Public Documents", create directory if not found?=FALSE) -> (system directory=w8)
          Build Path(base path=w8, name or relative path="Dam_Config.txt") -> (appended path=w7)
        }
      }
      Open Or Create Or Replace File(error in=w4, file path (use dialog)=w7, operation (0:open)="open or create") -> (error out=w9, refnum out=w10)
      Property Node(instance in=w3, "File Path"=w7, "refnum"=w10) -> (instance out=w11)
      Property Node(instance in=w5, "Backup"=w11, error in=w9) -> (error out=w1, instance out=w2)
    }
    frame Error {
      w1 = $"Error in"
      w2 = $"Dam in"
    }
  }
  $"Dam out" <- w2
  $"Error out" <- w1
