vi "Set Lake Inflow.gvi"   [LabVIEW NXG 3.0.0]
# Use this VI to edit the Lake’s inflow rate.
inputs:
  "Intake Rate (cfs)": f64, required
  "Dam in": "Dam.gtype", required
  "Error in": error
outputs:
  "Dam out": "Dam.gtype"
  "Error out": error
uses:
  Lake.gtype::Write Intake.gvi
diagram:
  case ($"Error in") {
    frame No Error {
      # #BUG Using an In Place Element Structure,
      # instead of Cluster Properties nodes results
      # in an Internal Error with the Turbine .gtype
      disable {
        frame Disabled {
          in-place (after $"Dam in") {
            Unbundle Bundle Read Poser() -> ("Lake"=w3)
            call "Write Intake.gvi"(Lake in=w3, Intake Rate (cfs)=$"Intake Rate (cfs)", Error in=$"Error in") -> (Lake out=w4, Error out=w1)
            Unbundle Bundle Write Poser("Lake"=w4)
            w2 = _
          }
        }
        frame Enabled {
          Property Node(instance in=$"Dam in", error in=$"Error in") -> ("Lake"=w5, error out=w6, instance out=w7)
          call "Write Intake.gvi"(Lake in=w5, Intake Rate (cfs)=$"Intake Rate (cfs)", Error in=w6) -> (Lake out=w8, Error out=w9)
          Property Node(instance in=w7, "Lake"=w8, error in=w9) -> (error out=w1, instance out=w2)
        }
      }
    }
    frame Error {
      w1 = $"Error in"
      w2 = $"Dam in"
    }
  }
  $"Dam out" <- w2
  $"Error out" <- w1
