vi "Update Dam.gvi"   [LabVIEW NXG 3.0.0]
# This VI updates the dam’s statee.
# Call this VI once a second.
inputs:
  "Dam in": "Dam.gtype", required
  "Error in": error
outputs:
  "Fill (Acre-feet)": f64
  "Dam out": "Dam.gtype"
  "Error out": error
uses:
  Lake.gtype::Update Level.gvi
  Lake.gtype::Read Lake Level.gvi
diagram:
  case ($"Error in") {
    frame No Error {
      Property Node(instance in=$"Dam in", error in=$"Error in") -> ("Lake"=w4, error out=w5, instance out=w6)
      call "Update Level.gvi"(Lake in=w4, Error in=w5) -> (Lake out=w7, Error out=w8)
      call "Read Lake Level.gvi"(Lake in=w7, Error in=w8) -> (Lake out=w9, Fill (Acre-feet)=w3, Error out=w10)
      Property Node(instance in=w6, "Lake"=w9, error in=w10) -> (error out=w1, instance out=w2)
    }
    frame Error {
      w1 = $"Error in"
      w2 = $"Dam in"
      w3 = default
    }
  }
  $"Fill (Acre-feet)" <- w3
  $"Dam out" <- w2
  $"Error out" <- w1
