vi "Write Config File.gvi"   [LabVIEW NXG 3.0.0]
# Use this VI to log the current status of the dam. You should pass a TXT file reference or the VI will prompt for a location in where to save. The VI will write the dam’s status as a JSON object.
inputs:
  "dam.gtype out": "Dam.gtype", required
  "TXT refnum in": ByteStreamFileRefnum
  "error in": error
outputs:
  "dam.gtype in": "Dam.gtype"
  "TXT refnum out": ByteStreamFileRefnum
  "error out": error
uses:
  Dam.gtype::Get Dams Data.gvi
diagram:
  case ($"error in") {
    frame Error, Default {
      w1 = $"error in"
      w2 = $"TXT refnum in"
      w3 = $"dam.gtype out"
    }
    frame No Error {
      Is Not A Number Or Path Or Refnum(number=$"TXT refnum in") -> w4
      case (w4) {
        frame False, Default {
          w5 = $"TXT refnum in"
          w6 = $"error in"
        }
        frame True {
          Open Or Create Or Replace File(error in=$"error in", operation (0:open)="replace or create with confirmation", prompt="Choose or enter a .txt file to save the configuration...") -> (error out=w6, refnum out=w5)
        }
      }
      call "Get Dams Data.gvi"(Dam in=$"dam.gtype out", Error in=w6) -> (Dam out=w3, Dam's data=w7, Error out=w8)
      Flatten To JSON(anything=w7, error in (no error)=w8) -> (JSON string=w9, error out=w10)
      Write To Text File(error in=w10, file (use dialog)=w5, text=w9) -> (error out=w11, refnum out=w12)
      case (w4) {
        frame False, Default {
          w2 = w12
          w1 = w11
        }
        frame True {
          Close File(error in=w11, refnum=w12) -> (error out=w1)
          w2 = default
        }
      }
    }
  }
  $"dam.gtype in" <- w3
  $"TXT refnum out" <- w2
  $"error out" <- w1
