vi "Close.gvi"   [LabVIEW NXG 3.0.0]
# This VI closes a reference to a log file.
# This VI executes regardless of an incoming error.
inputs:
  "Report in": "Report.gtype", required
  "Error in": error
outputs:
  "Error out": error
diagram:
  Property Node(instance in=$"Report in") -> ("Report Refnum"=w1, error out=w2)
  Close File(error in=w2, refnum=w1) -> (error out=w3)
  Merge Errors($"Error in", w3) -> (error out=w4)
  $"Error out" <- w4
