vi "Read All.gvi"   [LabVIEW NXG 3.0.0]
# Read the entire log.
inputs:
  "Report in": "Report.gtype", required
  "Error in": error
outputs:
  "All Data": string
  "Report out": "Report.gtype"
  "Error out": error
diagram:
  case ($"Error in") {
    frame No Error {
      Property Node(instance in=$"Report in", error in=$"Error in") -> ("Report Refnum"=w4, error out=w5, instance out=w6)
      Read From Text File(error in=w5, file (use dialog)=w4) -> (error out=w7, refnum out=w8, text=w3)
      Property Node(instance in=w6, "Report Refnum"=w8, error in=w7) -> (error out=w1, instance out=w2)
    }
    frame Error {
      w1 = $"Error in"
      w2 = $"Report in"
      w3 = default
    }
  }
  $"All Data" <- w3
  $"Report out" <- w2
  $"Error out" <- w1
