vi "Write Status.gvi"   [LabVIEW NXG 3.0.0]
# Writes a new entry to the log with the current dam’s status.
inputs:
  "Report Data": "Report Data.gtype" = {"Lake properties"={"Lake Fill (Acre-feet)"=0, "Lake Intake Rate (cfs)"=0, "Lake Discharge Rate (cfs)"=0}, "Large Floodgates properties"={"# of Large Floodgates"=4, "Large Flodgates Size (cfs)"=0, "Large Floodgates Status"=[]}, "Small Floodgates properties"={"# of Small Floodgates"=5, "Small Floodgates Size (cfs)"=0, "Small Floodgates Status"=[]}, "Turbines properties"={"# of Turbines"=2, "Power at Max Flow (MW)"=0, "Turbine Gates Status"=[], "Turbines State (%)"=[], "Total Power Being Generated (MW)"=0}}, required
  "Report in": "Report.gtype", required
  "Error in": error
outputs:
  "Report out": "Report.gtype"
  "Error out": error
panel indicators:
  "Log Entry": string[]
types:
  "Lake properties.gtype" = cluster{"Lake Fill (Acre-feet)": f64, "Lake Intake Rate (cfs)": f64, "Lake Discharge Rate (cfs)": f64}
  "Large Floodgates properties.gtype" = cluster{"# of Large Floodgates": i32, "Large Flodgates Size (cfs)": f64, "Large Floodgates Status": bool[]}
  "Small Floodgates properties.gtype" = cluster{"# of Small Floodgates": i32, "Small Floodgates Size (cfs)": f64, "Small Floodgates Status": bool[]}
  "Turbines properties.gtype" = cluster{"# of Turbines": i32, "Power at Max Flow (MW)": f64, "Turbine Gates Status": bool[], "Turbines State (%)": f64[], "Total Power Being Generated (MW)": f64}
  "Report Data.gtype" = cluster{"Lake properties": "Lake properties.gtype", "Large Floodgates properties": "Large Floodgates properties.gtype", "Small Floodgates properties": "Small Floodgates properties.gtype", "Turbines properties": "Turbines properties.gtype"}
diagram:
  case ($"Error in") {
    frame No Error {
      Property Node(instance in=$"Report in") -> ("Report Refnum"=w4, error out=w5, instance out=w6)
      Property Node(instance in=$"Report Data") -> ("Lake properties"=w7, "Large Floodgates properties"=w8, "Small Floodgates properties"=w9, "Turbines properties"=w10)
      Property Node(instance in=w9) -> ("Small Floodgates Status"=w11)
      Property Node(instance in=w8) -> ("Large Floodgates Status"=w12)
      Build Array(w12, w11) -> w13
      for {
        w14 = each element of w13
        Select(s=w14, t="OPEN", f="CLOSED") -> w16
        append w16 to w15
      }
      Property Node(instance in=w10) -> ("Turbine Gates Status"=w17, "Turbines State (%)"=w18, "Total Power Being Generated (MW)"=w19)
      for {
        w20 = each element of w17
        w21 = each element of w18
        Select(s=w20, t="OPEN", f="CLOSED") -> w24
        Number To Fractional String(number=w21) -> (F-format string=w25)
        append w24 to w22
        append w25 to w23
      }
      Property Node(instance in=w7) -> ("Lake Fill (Acre-feet)"=w26, "Lake Intake Rate (cfs)"=w27, "Lake Discharge Rate (cfs)"=w28)
      Number To Fractional String(number=w26) -> (F-format string=w29)
      Number To Fractional String(number=w28) -> (F-format string=w30)
      Number To Fractional String(number=w19) -> (F-format string=w31)
      Subtract(x=w27, y=w28) -> w32
      Is Equal To 0(x=w32) -> w33
      Is Greater Than 0(x=w32) -> w34
      Select(s=w34, t="Increasing Trend", f="Decreasing Trend") -> w35
      Select(s=w33, t="Flat Trend", f=w35) -> w36
      Format Date Time String(time format string (%c)="%m/%d/%Y %H:%M:%S") -> (date/time string=w37)
      Build Array(w37, w29, w15, w22, w23, w31, w30, w36) -> w3
      s1 = ""  # shift register
      for (iteration -> i1) {
        w38 = each element of w3
        Is Not Equal To 0(x=i1) -> w39
        Select(s=w39, t="\t", f="") -> w40
        Concatenate Strings(s1, w40, w38) -> w41
        next s1 = w41
      }
      Write To Text File(error in=w5, file (use dialog)=w4, text=s1) -> (error out=w42, refnum out=w43)
      Property Node(instance in=w6, "Report Refnum"=w43, error in=w42) -> (instance out=w2)
      w1 = $"Error in"
    }
    frame Error {
      w1 = $"Error in"
      w2 = $"Report in"
      w3 = default
    }
  }
  $"Error out" <- w1
  $"Log Entry" <- w3
  $"Report out" <- w2
