vi "Main.gvi"   [LabVIEW NXG 3.0.0]
panel controls:
  "Stop": bool
  "Settings": i32
  "Inflow (cfs)": f64 = 1000
  "Large Floodgates Status": bool[] = [FALSE, FALSE, FALSE, FALSE]
  "Small Floodgates Status": bool[] = [FALSE, FALSE, FALSE, FALSE, FALSE]
  "Turbines Status": bool[] = [FALSE, TRUE, FALSE, FALSE]
  "Turbines Open Gap (%)": f64[] = [41.8597271091, 60.594530904]
  "Reset": bool
  "Load Config File": path
  "Save Config File": bool
  "Close Large Floodgates": bool
  "Open Large Floodgates": bool
  "Close Small Floodgates": bool
  "Open Small Floodgates": bool
panel indicators:
  "Lake Fill (Acre-feet)": f64
  "Inflow (cfs) reading": f64
  "Total Power Generation (MW)": f64
  "Log Path": path
  "Fill (Acre-feet)": f64
  "Small Floodgate_1": bool
  "Small Floodgate_2": bool
  "Small Floodgate_3": bool
  "Small Floodgate_4": bool
  "Small Floodgate_5": bool
  "Large Floodgate_1": bool
  "Large Floodgate_2": bool
  "Large Floodgate_3": bool
  "Large Floodgate_4": bool
  "Turbine 1": bool
  "Turbine 2": bool
  "Turbine 1 Open": f64
  "Turbine 2 Open": f64
types:
  T1 = cluster{"Element 1": bool[], "Element 2": bool[]}
uses:
  NI::G Core::Error::Build Error Cluster.gvi
  Dam.gtype::Close.gvi
  Dam.gtype::Update Dam.gvi
  Dam.gtype::Get Dams Data.gvi
  Dam.gtype::Log Status.gvi
  NI::G Core::Error::Clear Error Cluster.gvi
  Dam.gtype::Init.gvi
  Dam.gtype::Set Lake Inflow.gvi
  Dam.gtype::Set Turbines Status.gvi
  Dam.gtype::Set Floodgates Status.gvi
  Dam.gtype::Write Config File.gvi
  NI::G Core::Error::Multiplex Errors.gvi
  NI::G Core::Error::Display Error.gvi
diagram:
  call "Open QMH.gvi"() -> (Message Queue=w1, Stop Event=w2, error out=w3)
  call "Send Message.gvi"(Queue in=w1, Command="Initialize", Data=FALSE, Input=w3) -> (Queue out=w4, Output=w5)
  Register For Events("Stop Event"=w2, error in=w5) -> (error out=w6, event registration refnum out=w7)
  while {
    event (timeout = 50) (dynamic events = w7) {
      on "Stop" Value changed {
        call "Send Message.gvi"(Queue in=w4, Command="Stop", Data=w6, Input=w6) -> (Output=w9)
        # This case sends a stop to the dam
        # It DOES NOT stop the consumer loop
        w8 = default
      }
      on "Dynamic" Stop Event {
        # This case stops the consumer loop
        # We make sure this can only happen if the producer loop stops too
        Event Data() -> ("event data"=w8)
        w9 = w6
      }
      on Timeout {
        call "Update Dam and Log.gvi"(Message Queue In=w4, Dam Update Time=1, Log Time=60, Error Input=w6) -> (Error Output=w9)
        # This case is used to keep the dam updated
        # Configure here the timing in which we refresh the dam
        # and the timing in which we log.
        w8 = default
      }
      on "Reset" Value changed {
        # This case sends a reset to the dam
        # It sets all values to the default data
        Build Cluster(TRUE, path constant) -> w10
        call "Send Message.gvi"(Queue in=w4, Command="Initialize", Data=w10, Input=w6) -> (Output=w9)
        w8 = default
      }
      on "Inflow (cfs)" Value changed {
        call "Send Message.gvi"(Queue in=w4, Command="Change Inflow", Data=$"Inflow (cfs)", Input=w6) -> (Output=w9)
        # This case sends a new inflow to the dam
        w8 = default
      }
      on "Turbines Open Gap (%)" Value changed; "Turbines Status" Value changed {
        Build Cluster($"Turbines Status", $"Turbines Open Gap (%)") -> w11
        # This case sends a new turbine settings to the dam
        call "Send Message.gvi"(Queue in=w4, Command="ChangeTurbines Status", Data=w11, Input=w6) -> (Output=w9)
        w8 = default
      }
      on "Large Floodgates Status" Value changed; "Small Floodgates Status" Value changed {
        Build Cluster($"Large Floodgates Status", $"Small Floodgates Status") -> w12
        # This case sends new floodgate settings to the dam
        call "Send Message.gvi"(Queue in=w4, Command="Change Floodgates Status", Data=w12, Input=w6) -> (Output=w9)
        w8 = default
      }
      on "Load Config File" Value changed {
        # This case sends a new config file to the dam
        # It sets all values to the default data
        Build Cluster(FALSE, $"Load Config File") -> w13
        call "Send Message.gvi"(Queue in=w4, Command="Initialize", Data=w13, Input=w6) -> (Output=w9)
        w8 = default
      }
      on "Save Config File" Value changed {
        call "Send Message.gvi"(Queue in=w4, Command="Save Config File", Input=w6) -> (Output=w9)
        w8 = default
      }
      on "Close Large Floodgates" Value changed; "Open Large Floodgates" Value changed {
        Property Node(instance in=reference to "Large Floodgates Status", error in=w6) -> ("Value"=w14, error out=w15, instance out=w16)
        Array Size(array=w14) -> (size(s)=w17)
        Initialize Array(element=$"Open Large Floodgates", size=w17) -> w18
        Property Node(instance in=w16, "ValueSignaling"=w18, error in=w15) -> (error out=w9)
        w8 = default
      }
      on "Close Small Floodgates" Value changed; "Open Small Floodgates" Value changed {
        Property Node(instance in=reference to "Small Floodgates Status", error in=w6) -> ("Value"=w19, error out=w20, instance out=w21)
        Array Size(array=w19) -> (size(s)=w22)
        Initialize Array(element=$"Open Small Floodgates", size=w22) -> w23
        Property Node(instance in=w21, "ValueSignaling"=w23, error in=w20) -> (error out=w9)
        w8 = default
      }
    }
    call "Error Check.gvi"(Message Queue In=w4, Error In=w9) -> (Message Queue Out=w24, Error Output=w25)
    Logical Or(w25, w8) -> w26
    stop if w26
  }
  s1 = "Dam.gtype" constant  # shift register
  while {
    call "Read Message.gvi"(Message Queue In=w4, Error in=w6) -> (Message Queue Out=w27, Command=w28, Data=w29, Error out=w30)
    case (w28) {
      frame Default {
        # This case executes when an undefined command arrives
        Format Into String(initString="Unknown command received: ", errIn=w30, w28) -> (outString=w34, errOut=w35)
        call "Build Error Cluster.gvi"(error in=w35, code=5000, description=w34) -> (error out=w31)
        w32 = default
        w33 = s1
      }
      frame "Stop" {
        Variant To Data(error in (no error)=w30, type=w30, variant=w29) -> (data=w36, error out=w37)
        Generate User Event(error in=w37, event data=TRUE, user event=w2) -> (error out=w38)
        call "Close.gvi"(Dam in=s1, Error in=w38) -> (Error out=w39)
        # This case stops the dam and sends a stop command to the producer loop
        Merge Errors(w36, w39) -> (error out=w31)
        w32 = TRUE
        w33 = "Dam.gtype" constant
      }
      frame "Update Dam" {
        call "Update Dam.gvi"(Dam in=s1, Error in=w30) -> (Dam out=w40, Fill (Acre-feet)=w41, Power Generated (MW)=w42, Error out=w43)
        call "Get Dams Data.gvi"(Dam in=w40, Error in=w43) -> (Dam out=w33, Dam's data=w44, Error out=w31)
        Property Node(instance in=w44) -> ("Large Floodgates properties"=w45, "Small Floodgates properties"=w46, "Turbines properties"=w47)
        Property Node(instance in=w45) -> ("Large Floodgates Status"=w48)
        Array Index(array=w48) -> (out0[_]=w49, out1[_]=w50, out2[_]=w51, out3[_]=w52)
        $"Large Floodgate_1" <- w49
        $"Large Floodgate_2" <- w50
        $"Large Floodgate_3" <- w51
        $"Large Floodgate_4" <- w52
        # This case should be run every second to make sure the dam updates its levels every second.
        $"Fill (Acre-feet)" <- w41
        Property Node(instance in=w46) -> ("Small Floodgates Status"=w53)
        Array Index(array=w53) -> (out0[_]=w54, out1[_]=w55, out2[_]=w56, out3[_]=w57, out4[_]=w58)
        $"Small Floodgate_1" <- w54
        $"Lake Fill (Acre-feet)" <- w41
        $"Small Floodgate_2" <- w55
        $"Small Floodgate_3" <- w56
        $"Total Power Generation (MW)" <- w42
        $"Small Floodgate_4" <- w57
        $"Small Floodgate_5" <- w58
        Property Node(instance in=w47) -> ("Turbine Gates Status"=w59, "Turbines State (%)"=w60)
        Array Index(array=w59) -> (out0[_]=w61, out1[_]=w62)
        $"Turbine 1" <- w61
        $"Turbine 2" <- w62
        Array Index(array=w60) -> (out0[_]=w63, out1[_]=w64)
        $"Turbine 1 Open" <- w63
        $"Turbine 2 Open" <- w64
        w32 = default
      }
      frame "Log" {
        # This case asks the dam to log its state into its report
        call "Log Status.gvi"(Dam in=s1, Error in=w30) -> (Dam out=w33, Error out=w31)
        w32 = default
      }
      frame "Initialize" {
        Clear Data(reference in=reference to "Lake Fill (Acre-feet)") -> (error out=w65)
        call "Clear Error Cluster.gvi"(error in=w65)
        call "Close.gvi"(Dam in=s1, Error in=w30) -> (Error out=w66)
        call "Clear Error Cluster.gvi"(error in=w66) -> (error out=w67)
        w68 = cluster{"Element 1": bool, "Element 2": path} {all zero or empty}
        Variant To Data(type=w68, variant=w29) -> (data=w69, error out=w70)
        Property Node(instance in=w69) -> ("Element 1"=w71, "Element 2"=w72)
        call "Init.gvi"(Status backup=w72, Reset?=w71, Error in=w67) -> (Dam's data=w73, Dam out=w33, Log Path Out=w74, Error out=w31)
        $"Log Path" <- w74
        call "Clear Error Cluster.gvi"(error in=w70)
        Property Node(instance in=w73) -> ("Lake properties"=w75, "Large Floodgates properties"=w76, "Small Floodgates properties"=w77, "Turbines properties"=w78)
        Property Node(instance in=w75) -> ("Lake Intake Rate (cfs)"=w79)
        $"Inflow (cfs) reading" <- w79
        $"Inflow (cfs)" <- w79
        # This case initializes a new dam.
        # You can use it to reset it to its default values, too
        Property Node(instance in=w76) -> ("Large Floodgates Status"=w80)
        $"Large Floodgates Status" <- w80
        Property Node(instance in=w77) -> ("Small Floodgates Status"=w81)
        $"Small Floodgates Status" <- w81
        Property Node(instance in=w78) -> ("Turbine Gates Status"=w82, "Turbines State (%)"=w83)
        $"Turbines Status" <- w82
        $"Turbines Open Gap (%)" <- w83
        w32 = default
      }
      frame "Change Inflow" {
        Variant To Data(error in (no error)=w30, type=f64 0, variant=w29) -> (data=w84, error out=w85)
        call "Set Lake Inflow.gvi"(Dam in=s1, Intake Rate (cfs)=w84, Error in=w85) -> (Dam out=w33, Intake Rate out (cfs)=w86, Error out=w31)
        # Use this case to change the inflow rate of the dam
        $"Inflow (cfs) reading" <- w86
        w32 = default
      }
      frame "ChangeTurbines Status" {
        # Use this case to change the turbines status of the dam
        w87 = cluster{"Element 1": bool[], "Element 2": f64[]} {all zero or empty}
        Variant To Data(error in (no error)=w30, type=w87, variant=w29) -> (data=w88, error out=w89)
        Property Node(instance in=w88) -> ("Element 1"=w90, "Element 2"=w91)
        call "Set Turbines Status.gvi"(Dam in=s1, Turbines Status=w90, Turbine Gates=w91, Error in=w89) -> (Dam out=w33, Turbines Status Out=w92, Turbine Gates Out=w93, Error out=w31)
        $"Turbines Status" <- w92
        $"Turbines Open Gap (%)" <- w93
        w32 = default
      }
      frame "Change Floodgates Status" {
        # Use this case to change the turbines status of the dam
        Variant To Data(error in (no error)=w30, type=T1 {all zero or empty}, variant=w29) -> (data=w94, error out=w95)
        Property Node(instance in=w94) -> ("Element 1"=w96, "Element 2"=w97)
        call "Set Floodgates Status.gvi"(Dam in=s1, Large Floodgates Status=w96, Small Floodgates Status=w97, Error in=w95) -> (Dam out=w33, Large Floodgates Status Out=w98, Small Floodgates Status Out=w99, Error out=w31)
        $"Large Floodgates Status" <- w98
        $"Small Floodgates Status" <- w99
        w32 = default
      }
      frame "Save Config File" {
        call "Write Config File.gvi"(dam.gtype out=s1, error in=w30) -> (dam.gtype in=w33, error out=w31)
        w32 = default
      }
    }
    call "Error Check.gvi"(Message Queue In=w27, Error In=w31) -> (Error Output=w100)
    Merge Errors(w31, w100) -> (error out=w101)
    next s1 = w33
    stop if w32
  }
  call "Multiplex Errors.gvi"(error in 1=w25, error in 2=w101) -> (error out=w102)
  Unregister For Events(error in=w102, event registration refnum=w7) -> (error out=w103)
  call "Close QMH.gvi"(Message Queue=w24, Stop Event=w2, error in=w103) -> (error out=w104)
  call "Display Error.gvi"(error in=w104)
