vi "Update Dam and Log.gvi"   [LabVIEW NXG 3.0.0]
# This VI checks for an elapsed time to update the dam and log the dam’s data
inputs:
  "Message Queue In": Queue<"Message.gtype">, required
  "Dam Update Time": f64 = 1, required
  "Log Time": f64 = 60, required
  "Error Input": error
outputs:
  "Error Output": error
  "Message Queue Out": Queue<"Message.gtype">
types:
  "Commands.gtype" = enum{"Stop", "Update Dam", "Log"}
  "Message.gtype" = cluster{"Command": "Commands.gtype", "Variant": variant}
uses:
  NI::G Core::Timing::Elapsed Timer.gvi
diagram:
  case ($"Error Input") {
    frame Error, Default {
      w1 = $"Error Input"
      w2 = $"Message Queue In"
    }
    frame No Error {
      call "Elapsed Timer.gvi"(target time=$"Log Time") -> (time has elapsed=w3)
      call "Elapsed Timer.gvi"(target time=$"Dam Update Time") -> (time has elapsed=w4)
      case (w4) {
        frame False, Default {
          w5 = $"Error Input"
          w6 = $"Message Queue In"
        }
        frame True {
          call "Send Message.gvi"(Queue in=$"Message Queue In", Command="Update Dam", Input=$"Error Input") -> (Queue out=w6, Output=w5)
        }
      }
      case (w3) {
        frame False, Default {
          w1 = w5
          w2 = w6
        }
        frame True {
          call "Send Message.gvi"(Queue in=w6, Command="Log", Input=w5) -> (Queue out=w2, Output=w1)
        }
      }
    }
  }
  $"Message Queue Out" <- w2
  $"Error Output" <- w1
