vi "Parse Compelted Tasks.gviweb"   [LabVIEW NXG 3.0.0]
# Use this VI to parse completed tasks to an array of strings that can be shown in the front panel.
inputs:
  "Completed Tasks": "Task Data.gtype"[], required
outputs:
  "Completed Tasks Strings": string[]
types:
  "Task Types.gtype" = enum{"Patch Tee Hole", "Rake Sand Trap", "Retrieve Balls from Creek"}
  "Task Status.gtype" = enum{"Waiting", "Running", "Completed", "Failed"}
  "Task Data.gtype" = cluster{"Task Type": "Task Types.gtype", "Remaining time (s)": f64, "Status": "Task Status.gtype", "Index": u32, "Start Time": timestamp, "End Time": timestamp}
diagram:
  for {
    w1 = each element of $"Completed Tasks"
    Property Node(instance in=w1) -> ("Task Type"=w3, "Index"=w4, "End Time"=w5)
    Format Into String(w3) -> w6
    Is Equal To 0(x=w4) -> w7
    Number To Decimal String(number=w4) -> (decimal integer string=w8)
    Concatenate Strings(" # ", w8) -> w9
    Select(s=w7, t="", f=w9) -> w10
    Get Date And Time String(time stamp=w5) -> (time string=w11)
    Concatenate Strings(w6, w10, " finished at ", w11) -> w12
    append w12 to w2
  }
  $"Completed Tasks Strings" <- w2
