vi "Parse Queue of Tasks.gviweb"   [LabVIEW NXG 3.0.0]
# Use this VI to parse tasks in the queue to an array of strings that can be shown in the front panel.
inputs:
  "Tasks in Queue": "Task Data.gtype"[], required
outputs:
  "Pending Tasks": string[]
  "% complete": f64[]
types:
  "Task Types.gtype" = enum{"Patch Tee Hole", "Rake Sand Trap", "Retrieve Balls from Creek"}
  "Task Status.gtype" = enum{"Waiting", "Running", "Completed", "Failed"}
  "Task Data.gtype" = cluster{"Task Type": "Task Types.gtype", "Remaining time (s)": f64, "Status": "Task Status.gtype", "Index": u32, "Start Time": timestamp, "End Time": timestamp}
uses:
  Application::Task functions::Get Task Type Time.gviweb
diagram:
  for {
    w1 = each element of $"Tasks in Queue"
    Property Node(instance in=w1) -> ("Task Type"=w4, "Index"=w5, "Remaining time (s)"=w6)
    Format Into String(w4) -> w7
    Number To Decimal String(number=w5) -> (decimal integer string=w8)
    Concatenate Strings(" # ", w8) -> w9
    Is Equal To 0(x=w5) -> w10
    Select(s=w10, t="", f=w9) -> w11
    call "Get Task Type Time.gviweb"(Task Type=w4) -> (Task time (s)=w12)
    Divide(x=w6, y=w12) -> w13
    Multiply(w13, 100) -> w14
    Subtract(x=100, y=w14) -> w15
    Number To Fractional String(number=w15, precision (6)=2) -> (F-format string=w16)
    Number To Fractional String(number=w6, precision (6)=2) -> (F-format string=w17)
    Concatenate Strings(w7, w11, " is ", w16, "% complete to finish in ", w17, " seconds.") -> w18
    append w18 to w2
    append w15 to w3
  }
  $"Pending Tasks" <- w2
  $"% complete" <- w3
